# Grasshopper definition robot simulation 05.gh (Grasshopper 1.0.7)
# plug-ins: Robots

crv = Curve(<curve referenced from the Rhino model>)
crv_2 = Curve(<curve referenced from the Rhino model>)
crv_3 = Curve(<curve referenced from the Rhino model>)
crv_4 = Curve(<curve referenced from the Rhino model>)
X = UnitX(Factor=Slider(65, range=0..100))
crv_5 = Curve(<curve referenced from the Rhino model>)
crv_6 = Curve(<curve referenced from the Rhino model>)
X_2 = UnitX(Factor=Slider(65, range=0..100))
crv_7 = Curve(<curve referenced from the Rhino model>)
X_3 = UnitX(Factor=Slider(65, range=0..100))
X_4 = UnitX(Factor=Slider(65, range=0..100))
move = Move(Geometry=crv, Motion=X)  # -> Geometry, Transform
move_2 = Move(Geometry=crv_2, Motion=X_2)  # -> Geometry, Transform
X_5 = UnitX(Factor=Slider(65, range=0..100))
X_6 = UnitX(Factor=Slider(65, range=0..100))
move_3 = Move(Geometry=crv_3, Motion=X_3)  # -> Geometry, Transform
X_7 = UnitX(Factor=Slider(65, range=0..100))
midpt = CurveMiddle(Curve=move.Geometry)
move_4 = Move(Geometry=crv_4, Motion=X_4)  # -> Geometry, Transform
midpt_2 = CurveMiddle(Curve=move_2.Geometry)
midpt_3 = CurveMiddle(Curve=move_3.Geometry)
X_8 = UnitX(Factor=Slider(65, range=0..100))
end = EndPoints(Curve=move.Geometry)  # -> Start, End
midpt_4 = CurveMiddle(Curve=move_4.Geometry)
end_2 = EndPoints(Curve=move_2.Geometry)  # -> Start, End
move_5 = Move(Geometry=crv_5, Motion=X_5)  # -> Geometry, Transform
move_6 = Move(Geometry=crv_6, Motion=X_6)  # -> Geometry, Transform
end_3 = EndPoints(Curve=move_3.Geometry)  # -> Start, End
move_7 = Move(Geometry=crv_7, Motion=X_7)  # -> Geometry, Transform
end_4 = EndPoints(Curve=move_4.Geometry)  # -> Start, End
midpt_5 = CurveMiddle(Curve=move_5.Geometry)
midpt_6 = CurveMiddle(Curve=move_6.Geometry)
midpt_7 = CurveMiddle(Curve=move_7.Geometry)
vec2pt = Vector2Pt(PointA=end.Start, PointB=end.End, Unitize=False)  # -> Vector, Length
vec2pt_2 = Vector2Pt(PointA=end_2.Start, PointB=end_2.End, Unitize=False)  # -> Vector, Length
end_5 = EndPoints(Curve=move_5.Geometry)  # -> Start, End
end_6 = EndPoints(Curve=move_6.Geometry)  # -> Start, End
vec2pt_3 = Vector2Pt(PointA=end_3.Start, PointB=end_3.End, Unitize=False)  # -> Vector, Length
end_7 = EndPoints(Curve=move_7.Geometry)  # -> Start, End
vec2pt_4 = Vector2Pt(PointA=end_4.Start, PointB=end_4.End, Unitize=False)  # -> Vector, Length
rot3d = Rotate3D(Geometry=crv, Angle=degrees("-30"), Center=midpt, Axis=vec2pt.Vector)  # -> Geometry, Transform
vec2pt_5 = Vector2Pt(PointA=end_5.Start, PointB=end_5.End, Unitize=False)  # -> Vector, Length
rot3d_2 = Rotate3D(Geometry=crv_2, Angle=degrees("-25"), Center=midpt_2, Axis=vec2pt_2.Vector)  # -> Geometry, Transform
vec2pt_6 = Vector2Pt(PointA=end_6.Start, PointB=end_6.End, Unitize=False)  # -> Vector, Length
rot3d_3 = Rotate3D(Geometry=crv_3, Angle=degrees("-20"), Center=midpt_3, Axis=vec2pt_3.Vector)  # -> Geometry, Transform
vec2pt_7 = Vector2Pt(PointA=end_7.Start, PointB=end_7.End, Unitize=False)  # -> Vector, Length
rot3d_4 = Rotate3D(Geometry=crv_4, Angle=degrees("-35"), Center=midpt_4, Axis=vec2pt_4.Vector)  # -> Geometry, Transform
rot3d_5 = Rotate3D(Geometry=crv_5, Angle=degrees("-10"), Center=midpt_5, Axis=vec2pt_5.Vector)  # -> Geometry, Transform
rot3d_6 = Rotate3D(Geometry=crv_6, Angle=degrees("-40"), Center=midpt_6, Axis=vec2pt_6.Vector)  # -> Geometry, Transform
rot3d_7 = Rotate3D(Geometry=crv_7, Angle=degrees("-15"), Center=midpt_7, Axis=vec2pt_7.Vector)  # -> Geometry, Transform

list = ValueList({"AA-KR60", "AA-KR30", "AA-KR60_KR30", "AARCH IRB120", "AARCH IRB6620", "AAU-Utzon-UR10", "Automata", "Bartlett-IRB120", "Bartlett-IRB1600", "Bartlett-KR6"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}, selected="iaac-IRB140")
xy = XYPlane(Origin=Point(0, 0, 0))
load_robot = LoadRobotSystem(Name=list, Base=xy)

# ---- group: pin number
panel = Panel("1")

# ----
number_slider = Slider(60, range=-45..60)  # disabled
number_slider_2 = Slider(65, range=0..100)  # disabled
crv_8 = Curve(<curve referenced from the Rhino model>)  # disabled
panel_2 = Panel("5")  # disabled
X_9 = UnitX(Factor=number_slider_2)  # disabled
division = Division(A=number_slider, B=panel_2)  # disabled
abs = Absolute(Value=division)  # disabled
move_8 = Move(Geometry=crv_8, Motion=X_9)  # -> Geometry, Transform; disabled
midpt_8 = CurveMiddle(Curve=move_8.Geometry)  # disabled
end_8 = EndPoints(Curve=move_8.Geometry)  # -> Start, End; disabled
series = Series(Start=panel_2, Step=panel_2, Count=abs)  # disabled
vec2pt_8 = Vector2Pt(PointA=end_8.Start, PointB=end_8.End, Unitize=False)  # -> Vector, Length; disabled
rot3d_8 = Rotate3D(Geometry=crv_8, Angle=expr("-x", degrees(series)), Center=midpt_8, Axis=vec2pt_8.Vector)  # -> Geometry, Transform; disabled
panel_3 = Panel(rot3d_8.Geometry)  # disabled
crv_9 = Curve(<curve referenced from the Rhino model>)  # disabled
degree = Slider(5, range=-90..90)  # disabled
number_slider_3 = Slider(0.1, range=0..10)  # disabled
number_slider_4 = Slider(0, range=0..1)  # disabled
number_slider_5 = Slider(27, range=0..100)  # disabled
number_slider_6 = Slider(80, range=0..1000)  # disabled
division_2 = Division(A=degree, B=number_slider_3)  # disabled
number_slider_7 = Slider(80, range=0..1000)  # disabled

number_slider_8 = Slider(0, range=0..100)  # disabled
mesh = Mesh(<mesh referenced from the Rhino model>)  # disabled
pt = Point(<point referenced from the Rhino model>)  # disabled
xy_2 = XYPlane(Origin=pt)  # disabled
number_slider_9 = Slider(-45, range=-90..90)  # disabled
rotate = Rotate(Geometry=mesh, Angle=expr("-x", degrees(number_slider_8)), Plane=PlaneXY(0, 0, 0))  # -> Geometry, Transform; disabled
deplane = DeconstructPlane(Plane=xy_2)  # -> Origin, XAxis, YAxis, ZAxis; disabled
rot3d_9 = Rotate3D(Geometry=xy_2, Angle=degrees(number_slider_9), Center=pt, Axis=deplane.ZAxis)  # -> Geometry, Transform; disabled
panel_4 = Panel("Bender")  # disabled
tool = CreateTool(Name=panel_4, TCP=rot3d_9.Geometry, Weight=0, Mesh=rotate.Geometry)  # -> Tool, TCP; disabled

number_slider_10 = Slider(80, range=0..1000)  # disabled
series_2 = Series(Start=0, Step=number_slider_4, Count=number_slider_5)  # disabled
series_3 = Series(Start=0, Step=number_slider_3, Count=division_2)  # disabled

end_9 = EndPoints(Curve=crv_9)  # -> Start, End; disabled
pflip = FlipPlane(Plane=end_9.Start, ReverseX=invert(False), ReverseY=False, SwapAxes=invert(True))  # disabled
number_slider_11 = Slider(10, range=0..10)  # disabled
panel_5 = Panel("1")  # disabled
panel_6 = Panel("True")  # disabled
panel_7 = Panel("False")  # disabled
setdo = SetDO(DO=panel_5, Value=panel_6)  # disabled
wait = Wait(Time=number_slider_11)  # disabled
setdo_2 = SetDO(DO=panel_5, Value=panel_7)  # disabled
merge = Merge(Data1=setdo, Data2=wait, Data3=setdo_2)  # -> flatten(Result); disabled
command = CommandParameter(merge)  # disabled
target = CreateTarget(Plane=pflip, Tool=tool.Tool, Command=command, IsCartesian=True)  # disabled

list_2 = ValueList({"AA-KR60", "AA-KR30", "AA-KR60_KR30", "AARCH IRB120", "AARCH IRB6620", "AAU-Utzon-UR10", "Automata", "Bartlett-IRB120", "Bartlett-IRB1600", "Bartlett-KR6"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}, selected="iaac-IRB140")  # disabled
xy_3 = XYPlane(Origin=Point(0, 0, 0))  # disabled
load_robot_2 = LoadRobotSystem(Name=list_2, Base=xy_3)  # disabled

number_slider_12 = Slider(0, range=-180..180)  # disabled
number_slider_13 = Slider(0, range=-180..180)  # disabled
number_slider_14 = Slider(0, range=-180..180)  # disabled
number_slider_15 = Slider(0, range=-180..180)  # disabled
number_slider_16 = Slider(0, range=-180..180)  # disabled
number_slider_17 = Slider(0, range=-180..180)  # disabled
merge_2 = Merge(
    Data1=number_slider_13,
    Data2=number_slider_14,
    Data3=number_slider_12,
    Data4=number_slider_15,
    Data5=number_slider_16,
    Data6=number_slider_17)  # disabled
degtorad = DegreesToRadians(Degrees=merge_2, RobotSystem=load_robot_2, MechanicalGroup=0)  # disabled
target_2 = CreateTarget(Joints=degtorad, Tool=tool.Tool, IsCartesian=False)  # disabled

flip = FlipCurve(Curve=crv_8)  # -> Curve, Flag; disabled
crv_10 = Curve(<curve referenced from the Rhino model>)  # disabled
merge_3 = Merge(Data1=series_2, Data2=series_3)  # disabled
divide = DivideCurve(Curve=crv_9, Count=number_slider_6, Kinks=False)  # -> Points, Tangents, Parameters; disabled
divide_2 = DivideCurve(Curve=flip.Curve, Count=number_slider_7, Kinks=False)  # -> Points, Tangents, Parameters; disabled
divide_3 = DivideCurve(Curve=crv_8, Count=number_slider_10, Kinks=False)  # -> Points, Tangents, Parameters; disabled
lng = ListLength(List=merge_3)  # disabled
hframe = HorizontalFrame(Curve=crv_9, Parameter=divide.Parameters)  # disabled
hframe_2 = HorizontalFrame(Curve=flip.Curve, Parameter=divide_2.Parameters)  # disabled
subtraction = Subtraction(A=number_slider_6, B=lng)  # disabled
hframe_3 = HorizontalFrame(Curve=crv_10, Parameter=divide_3.Parameters)  # disabled
pflip_2 = FlipPlane(Plane=hframe, ReverseX=False, ReverseY=False, SwapAxes=True)  # disabled
repeat = RepeatData(Data=degree, Length=subtraction)  # disabled
pflip_3 = FlipPlane(Plane=hframe_2, ReverseX=False, ReverseY=False, SwapAxes=True)  # disabled
pflip_4 = FlipPlane(Plane=hframe_3, ReverseX=invert(False), ReverseY=invert(False), SwapAxes=True)  # disabled
pln = Plane(pflip_2)  # disabled
pln_2 = Plane(pflip_3)  # disabled
ins = InsertItems(List=merge_3, Item=repeat, Indices=lng, Wrap=invert(True))  # disabled
pln_3 = Plane(pflip_4)  # disabled
deplane_2 = DeconstructPlane(Plane=pln)  # -> Origin, XAxis, simplify(YAxis), ZAxis; disabled
deplane_3 = DeconstructPlane(Plane=pln_2)  # -> Origin, simplify(XAxis), YAxis, ZAxis; disabled
pshift = ShiftPaths(Data=ins, Offset=-2)  # disabled
deplane_4 = DeconstructPlane(Plane=pln_3)  # -> Origin, simplify(XAxis), YAxis, ZAxis; disabled
rot3d_10 = Rotate3D(Geometry=pln, Angle=degrees(pshift), Center=pln, Axis=deplane_2.YAxis)  # -> Geometry, Transform; disabled
rot3d_11 = Rotate3D(Geometry=pln_2, Angle=degrees(degree), Center=pln_2, Axis=deplane_3.YAxis)  # -> Geometry, Transform; disabled
rot3d_12 = Rotate3D(Geometry=pln_3, Angle=degrees(pshift), Center=pln_3, Axis=deplane_4.YAxis)  # -> Geometry, Transform; disabled
target_3 = CreateTarget(Plane=rot3d_10.Geometry, Tool=tool.Tool, IsCartesian=True)  # disabled
target_4 = CreateTarget(Plane=rot3d_11.Geometry, Tool=tool.Tool, IsCartesian=True)  # disabled
target_5 = CreateTarget(Plane=rot3d_12.Geometry, Tool=tool.Tool, IsCartesian=True)  # disabled
number_slider_18 = Slider(0, range=0..1)  # disabled
panel_8 = Panel(pshift)  # disabled
entwine = Entwine(Branch00=target_2, Branch01=target, Branch02=target_4, Branch03=target_5, Branch021=target_2, FlattenInputs=True)  # disabled
panel_9 = Panel("BENDER")  # disabled
program = CreateProgram(Name=panel_9, RobotSystem=load_robot_2, Targets1=flatten(entwine), StepSize=1)  # -> Program, Code, Duration, Warnings, Errors; disabled
sim = ProgramSimulation(Program=program.Program, Time=number_slider_18, Normalized=True)  # -> SystemMeshes, JointRotations, Plane, Index, Time, Program, Errors; disabled
swatch = ColourSwatch(SwatchColor=RGB(245, 164, 164))  # disabled
panel_10 = Panel(program.Code)  # disabled
preview = CustomPreview(Geometry=sim.SystemMeshes, Material=swatch)  # disabled

crv_11 = Curve(<curve referenced from the Rhino model>)  # disabled
degree_2 = Slider(5, range=-90..90)  # disabled
number_slider_19 = Slider(80, range=0..1000)  # disabled
number_slider_20 = Slider(0.1, range=0..10)  # disabled
crv_12 = Curve(<curve referenced from the Rhino model>)  # disabled
number_slider_21 = Slider(24, range=0..100)  # disabled
number_slider_22 = Slider(0, range=0..1)  # disabled
flip_2 = FlipCurve(Curve=crv_12)  # -> Curve, Flag; disabled
division_3 = Division(A=degree_2, B=number_slider_20)  # disabled
divide_4 = DivideCurve(Curve=crv_12, Count=number_slider_19, Kinks=False)  # -> Points, Tangents, Parameters; disabled
divide_5 = DivideCurve(Curve=flip_2.Curve, Count=number_slider_19, Kinks=False)  # -> Points, Tangents, Parameters; disabled
series_4 = Series(Start=0, Step=number_slider_22, Count=number_slider_21)  # disabled
series_5 = Series(Start=0, Step=number_slider_20, Count=division_3)  # disabled
divide_6 = DivideCurve(Curve=crv_11, Count=number_slider_19, Kinks=False)  # -> Points, Tangents, Parameters; disabled
hframe_4 = HorizontalFrame(Curve=crv_12, Parameter=divide_4.Parameters)  # disabled
hframe_5 = HorizontalFrame(Curve=crv_12, Parameter=divide_5.Parameters)  # disabled
merge_4 = Merge(Data1=series_4, Data2=series_5)  # disabled
hframe_6 = HorizontalFrame(Curve=crv_11, Parameter=divide_6.Parameters)  # disabled
pflip_5 = FlipPlane(Plane=hframe_4, ReverseX=invert(False), ReverseY=False, SwapAxes=True)  # disabled
pflip_6 = FlipPlane(Plane=hframe_5, ReverseX=invert(False), ReverseY=False, SwapAxes=True)  # disabled
lng_2 = ListLength(List=merge_4)  # disabled
pflip_7 = FlipPlane(Plane=hframe_6, ReverseX=False, ReverseY=False, SwapAxes=True)  # disabled
pln_4 = Plane(pflip_5)  # disabled
subtraction_2 = Subtraction(A=number_slider_19, B=lng_2)  # disabled
pln_5 = Plane(pflip_6)  # disabled
pln_6 = Plane(pflip_7)  # disabled
deplane_5 = DeconstructPlane(Plane=pln_4)  # -> Origin, XAxis, simplify(YAxis), ZAxis; disabled
deplane_6 = DeconstructPlane(Plane=pln_5)  # -> Origin, XAxis, simplify(YAxis), ZAxis; disabled
repeat_2 = RepeatData(Data=degree_2, Length=subtraction_2)  # disabled
deplane_7 = DeconstructPlane(Plane=pln_6)  # -> Origin, XAxis, simplify(YAxis), ZAxis; disabled
ins_2 = InsertItems(List=merge_4, Item=repeat_2, Indices=lng_2, Wrap=invert(True))  # disabled
pshift_2 = ShiftPaths(Data=ins_2, Offset=-2)  # disabled
rot3d_13 = Rotate3D(Geometry=pln_5, Angle=degrees(pshift_2), Center=pln_5, Axis=deplane_6.YAxis)  # -> Geometry, Transform; disabled
rot3d_14 = Rotate3D(Geometry=pln_4, Angle=degrees(pshift_2), Center=pln_4, Axis=deplane_5.YAxis)  # -> Geometry, Transform; disabled
rot3d_15 = Rotate3D(Geometry=pln_6, Angle=degrees(pshift_2), Center=pln_6, Axis=deplane_7.YAxis)  # -> Geometry, Transform; disabled
list_3 = ValueList({"Joint", "Linear"}, selected="Linear")  # disabled

# ---- group: multiple passagges
number_slider_23 = Slider(80, range=0..1000)  # disabled
number_slider_24 = Slider(80, range=0..1000)  # disabled
crv_13 = Curve(<curve referenced from the Rhino model>)  # disabled
crv_14 = Curve(<curve referenced from the Rhino model>)  # disabled
flip_3 = FlipCurve(Curve=crv_13)  # -> Curve, Flag; disabled
divide_7 = DivideCurve(Curve=flip_3.Curve, Count=number_slider_23, Kinks=False)  # -> Points, Tangents, Parameters; disabled
divide_8 = DivideCurve(Curve=crv_14, Count=number_slider_24, Kinks=False)  # -> Points, Tangents, Parameters; disabled
hframe_7 = HorizontalFrame(Curve=flip_3.Curve, Parameter=divide_7.Parameters)  # disabled
hframe_8 = HorizontalFrame(Curve=crv_14, Parameter=divide_8.Parameters)  # disabled
pflip_8 = FlipPlane(Plane=hframe_8, ReverseX=invert(False), ReverseY=invert(False), SwapAxes=True)  # disabled
pflip_9 = FlipPlane(Plane=hframe_7, ReverseX=False, ReverseY=False, SwapAxes=True)  # disabled
pln_7 = Plane(pflip_9)  # disabled
pln_8 = Plane(pflip_8)  # disabled
deplane_8 = DeconstructPlane(Plane=pln_7)  # -> Origin, simplify(XAxis), YAxis, ZAxis; disabled
deplane_9 = DeconstructPlane(Plane=pln_8)  # -> Origin, simplify(XAxis), YAxis, ZAxis; disabled

# ----
crv_15 = Curve(<curve referenced from the Rhino model>)
flip_4 = FlipCurve(Curve=crv_15)  # -> Curve, Flag
divide_9 = DivideCurve(Curve=flip_4.Curve, Count=Slider(80, range=0..1000), Kinks=False)  # -> Points, Tangents, Parameters
hframe_9 = HorizontalFrame(Curve=flip_4.Curve, Parameter=divide_9.Parameters)
pflip_10 = FlipPlane(Plane=hframe_9, ReverseX=False, ReverseY=False, SwapAxes=True)
pln_9 = Plane(pflip_10)
deplane_10 = DeconstructPlane(Plane=pln_9)  # -> Origin, simplify(XAxis), YAxis, ZAxis
rot3d_16 = Rotate3D(Geometry=pln_9, Angle=degrees(0), Center=pln_9, Axis=deplane_10.YAxis)  # -> Geometry, Transform

move_9 = Move(Geometry=crv_15, Motion=X_8)  # -> Geometry, Transform
midpt_9 = CurveMiddle(Curve=move_9.Geometry)
end_10 = EndPoints(Curve=move_9.Geometry)  # -> Start, End
vec2pt_9 = Vector2Pt(PointA=end_10.Start, PointB=end_10.End, Unitize=False)  # -> Vector, Length
rot3d_17 = Rotate3D(Geometry=crv_15, Angle=degrees("-5"), Center=midpt_9, Axis=vec2pt_9.Vector)  # -> Geometry, Transform

degree_3 = Slider(5, range=-90..90)
number_slider_25 = Slider(0.1, range=0..10)
number_slider_26 = Slider(15, range=0..210)
division_4 = Division(A=degree_3, B=number_slider_25)
series_6 = Series(Start=number_slider_26, Step=Slider(0, range=0..1), Count=Slider(10, range=0..100))
series_7 = Series(Start=number_slider_26, Step=number_slider_25, Count=division_4)
merge_5 = Merge(Data1=series_6, Data2=series_7)
lng_3 = ListLength(List=merge_5)
crv_16 = Curve(rot3d_7.Geometry)
divide_10 = DivideCurve(Curve=crv_16, Count=Slider(80, range=0..1000), Kinks=False)  # -> Points, Tangents, Parameters
hframe_10 = HorizontalFrame(Curve=crv_16, Parameter=divide_10.Parameters)
pflip_11 = FlipPlane(Plane=hframe_10, ReverseX=invert(False), ReverseY=invert(False), SwapAxes=True)
pln_10 = Plane(pflip_11)
deplane_11 = DeconstructPlane(Plane=pln_10)  # -> Origin, simplify(XAxis), YAxis, ZAxis

degree_4 = Slider(5, range=-90..90)
number_slider_27 = Slider(0.1, range=0..10)
number_slider_28 = Slider(10, range=0..10)
division_5 = Division(A=degree_4, B=number_slider_27)
series_8 = Series(Start=number_slider_28, Step=Slider(0, range=0..1), Count=Slider(10, range=0..100))
series_9 = Series(Start=number_slider_28, Step=number_slider_27, Count=division_5)
merge_6 = Merge(Data1=series_8, Data2=series_9)
lng_4 = ListLength(List=merge_6)
crv_17 = Curve(rot3d_5.Geometry)
divide_11 = DivideCurve(Curve=crv_17, Count=Slider(80, range=0..1000), Kinks=False)  # -> Points, Tangents, Parameters
hframe_11 = HorizontalFrame(Curve=crv_17, Parameter=divide_11.Parameters)
pflip_12 = FlipPlane(Plane=hframe_11, ReverseX=invert(False), ReverseY=invert(False), SwapAxes=True)
pln_11 = Plane(pflip_12)
deplane_12 = DeconstructPlane(Plane=pln_11)  # -> Origin, simplify(XAxis), YAxis, ZAxis

degree_5 = Slider(5, range=-90..90)
number_slider_29 = Slider(0.1, range=0..10)
number_slider_30 = Slider(20, range=0..210)
division_6 = Division(A=degree_5, B=number_slider_29)
series_10 = Series(Start=number_slider_30, Step=Slider(0, range=0..1), Count=Slider(10, range=0..100))
series_11 = Series(Start=number_slider_30, Step=number_slider_29, Count=division_6)
merge_7 = Merge(Data1=series_10, Data2=series_11)
lng_5 = ListLength(List=merge_7)
crv_18 = Curve(rot3d_3.Geometry)
divide_12 = DivideCurve(Curve=crv_18, Count=Slider(80, range=0..1000), Kinks=False)  # -> Points, Tangents, Parameters
hframe_12 = HorizontalFrame(Curve=crv_18, Parameter=divide_12.Parameters)
pflip_13 = FlipPlane(Plane=hframe_12, ReverseX=invert(False), ReverseY=invert(False), SwapAxes=True)
pln_12 = Plane(pflip_13)
deplane_13 = DeconstructPlane(Plane=pln_12)  # -> Origin, simplify(XAxis), YAxis, ZAxis

degree_6 = Slider(5, range=-90..90)
number_slider_31 = Slider(0.1, range=0..10)
number_slider_32 = Slider(25, range=0..210)
division_7 = Division(A=degree_6, B=number_slider_31)
series_12 = Series(Start=number_slider_32, Step=Slider(0, range=0..1), Count=Slider(10, range=0..100))
series_13 = Series(Start=number_slider_32, Step=number_slider_31, Count=division_7)
merge_8 = Merge(Data1=series_12, Data2=series_13)
lng_6 = ListLength(List=merge_8)
crv_19 = Curve(rot3d_2.Geometry)
divide_13 = DivideCurve(Curve=crv_19, Count=Slider(80, range=0..1000), Kinks=False)  # -> Points, Tangents, Parameters
hframe_13 = HorizontalFrame(Curve=crv_19, Parameter=divide_13.Parameters)
pflip_14 = FlipPlane(Plane=hframe_13, ReverseX=invert(False), ReverseY=invert(False), SwapAxes=True)
pln_13 = Plane(pflip_14)
deplane_14 = DeconstructPlane(Plane=pln_13)  # -> Origin, simplify(XAxis), YAxis, ZAxis

degree_7 = Slider(5, range=-90..90)
number_slider_33 = Slider(0.1, range=0..10)
number_slider_34 = Slider(40, range=0..210)
division_8 = Division(A=degree_7, B=number_slider_33)
series_14 = Series(Start=number_slider_34, Step=Slider(0, range=0..1), Count=Slider(10, range=0..100))
series_15 = Series(Start=number_slider_34, Step=number_slider_33, Count=division_8)
merge_9 = Merge(Data1=series_14, Data2=series_15)
lng_7 = ListLength(List=merge_9)
crv_20 = Curve(rot3d_6.Geometry)
divide_14 = DivideCurve(Curve=crv_20, Count=Slider(80, range=0..1000), Kinks=False)  # -> Points, Tangents, Parameters
hframe_14 = HorizontalFrame(Curve=crv_20, Parameter=divide_14.Parameters)
pflip_15 = FlipPlane(Plane=hframe_14, ReverseX=invert(False), ReverseY=invert(False), SwapAxes=True)
pln_14 = Plane(pflip_15)
deplane_15 = DeconstructPlane(Plane=pln_14)  # -> Origin, simplify(XAxis), YAxis, ZAxis

degree_8 = Slider(5, range=-90..90)
number_slider_35 = Slider(0.1, range=0..10)
number_slider_36 = Slider(35, range=0..210)
division_9 = Division(A=degree_8, B=number_slider_35)
series_16 = Series(Start=number_slider_36, Step=Slider(0, range=0..1), Count=Slider(10, range=0..100))
series_17 = Series(Start=number_slider_36, Step=number_slider_35, Count=division_9)
merge_10 = Merge(Data1=series_16, Data2=series_17)
lng_8 = ListLength(List=merge_10)
crv_21 = Curve(rot3d_4.Geometry)
divide_15 = DivideCurve(Curve=crv_21, Count=Slider(80, range=0..1000), Kinks=False)  # -> Points, Tangents, Parameters
hframe_15 = HorizontalFrame(Curve=crv_21, Parameter=divide_15.Parameters)
pflip_16 = FlipPlane(Plane=hframe_15, ReverseX=invert(False), ReverseY=invert(False), SwapAxes=True)
pln_15 = Plane(pflip_16)
deplane_16 = DeconstructPlane(Plane=pln_15)  # -> Origin, simplify(XAxis), YAxis, ZAxis

degree_9 = Slider(5, range=-90..90)
number_slider_37 = Slider(0.1, range=0..10)
number_slider_38 = Slider(30, range=0..210)
division_10 = Division(A=degree_9, B=number_slider_37)
series_18 = Series(Start=number_slider_38, Step=Slider(0, range=0..1), Count=Slider(10, range=0..100))
series_19 = Series(Start=number_slider_38, Step=number_slider_37, Count=division_10)
merge_11 = Merge(Data1=series_18, Data2=series_19)
lng_9 = ListLength(List=merge_11)
crv_22 = Curve(rot3d.Geometry)
divide_16 = DivideCurve(Curve=crv_22, Count=Slider(80, range=0..1000), Kinks=False)  # -> Points, Tangents, Parameters
hframe_16 = HorizontalFrame(Curve=crv_22, Parameter=divide_16.Parameters)
pflip_17 = FlipPlane(Plane=hframe_16, ReverseX=invert(False), ReverseY=invert(False), SwapAxes=True)
pln_16 = Plane(pflip_17)
deplane_17 = DeconstructPlane(Plane=pln_16)  # -> Origin, simplify(XAxis), YAxis, ZAxis

degree_10 = Slider(5, range=-90..90)
number_slider_39 = Slider(0.1, range=0..10)
number_slider_40 = Slider(5, range=0..10)
division_11 = Division(A=degree_10, B=number_slider_39)
series_20 = Series(Start=number_slider_40, Step=Slider(0, range=0..1), Count=Slider(10, range=0..100))
series_21 = Series(Start=number_slider_40, Step=number_slider_39, Count=division_11)
merge_12 = Merge(Data1=series_20, Data2=series_21)
lng_10 = ListLength(List=merge_12)
crv_23 = Curve(rot3d_17.Geometry)
divide_17 = DivideCurve(Curve=crv_23, Count=Slider(80, range=0..1000), Kinks=False)  # -> Points, Tangents, Parameters
hframe_17 = HorizontalFrame(Curve=crv_23, Parameter=divide_17.Parameters)
pflip_18 = FlipPlane(Plane=hframe_17, ReverseX=invert(False), ReverseY=invert(False), SwapAxes=True)
pln_17 = Plane(pflip_18)
deplane_18 = DeconstructPlane(Plane=pln_17)  # -> Origin, simplify(XAxis), YAxis, ZAxis

# ---- group: multiple passagges (continued)
rot3d_18 = Rotate3D(Geometry=pln_7, Angle=degrees("10"), Center=pln_7, Axis=deplane_8.YAxis)  # -> Geometry, Transform; disabled
rot3d_19 = Rotate3D(Geometry=pln_8, Angle=degrees("10"), Center=pln_8, Axis=deplane_9.YAxis)  # -> Geometry, Transform; disabled
merge_13 = Merge(Data1=rot3d_18.Geometry, Data2=rot3d_19.Geometry, Data3=rot3d_18.Geometry)  # disabled

# ---- group: approach
degree_11 = Slider(5, range=-90..90)
number_slider_41 = Slider(0.1, range=0..10)
series_22 = Series(Start=0, Step=Slider(0, range=0..1), Count=Slider(27, range=0..100))

# ----
division_12 = Division(A=degree_11, B=number_slider_41)

# ---- group: approach
crv_24 = Curve(<curve referenced from the Rhino model>)
number_slider_42 = Slider(80, range=0..1000)
divide_18 = DivideCurve(Curve=crv_24, Count=number_slider_42, Kinks=False)  # -> Points, Tangents, Parameters
hframe_18 = HorizontalFrame(Curve=crv_24, Parameter=divide_18.Parameters)
pflip_19 = FlipPlane(Plane=hframe_18, ReverseX=False, ReverseY=False, SwapAxes=True)
pln_18 = Plane(pflip_19)
deplane_19 = DeconstructPlane(Plane=pln_18)  # -> Origin, XAxis, simplify(YAxis), ZAxis

series_23 = Series(Start=0, Step=number_slider_41, Count=division_12)
merge_14 = Merge(Data1=series_22, Data2=series_23)
lng_11 = ListLength(List=merge_14)
subtraction_3 = Subtraction(A=number_slider_42, B=lng_11)
repeat_3 = RepeatData(Data=degree_11, Length=subtraction_3)
ins_3 = InsertItems(List=merge_14, Item=repeat_3, Indices=lng_11, Wrap=invert(True))
pshift_3 = ShiftPaths(Data=ins_3, Offset=-2)

# ----
subtraction_4 = Subtraction(A=number_slider_42, B=lng_3)
repeat_4 = RepeatData(Data="20", Length=subtraction_4)
ins_4 = InsertItems(List=merge_5, Item=repeat_4, Indices=lng_3, Wrap=invert(True))
pshift_4 = ShiftPaths(Data=ins_4, Offset=-2)
rot3d_20 = Rotate3D(Geometry=pln_10, Angle=degrees(pshift_4), Center=pln_10, Axis=deplane_11.YAxis)  # -> Geometry, Transform

subtraction_5 = Subtraction(A=number_slider_42, B=lng_4)
repeat_5 = RepeatData(Data="15", Length=subtraction_5)
ins_5 = InsertItems(List=merge_6, Item=repeat_5, Indices=lng_4, Wrap=invert(True))
pshift_5 = ShiftPaths(Data=ins_5, Offset=-2)
rot3d_21 = Rotate3D(Geometry=pln_11, Angle=degrees(pshift_5), Center=pln_11, Axis=deplane_12.YAxis)  # -> Geometry, Transform

subtraction_6 = Subtraction(A=number_slider_42, B=lng_5)
repeat_6 = RepeatData(Data="25", Length=subtraction_6)
ins_6 = InsertItems(List=merge_7, Item=repeat_6, Indices=lng_5, Wrap=invert(True))
pshift_6 = ShiftPaths(Data=ins_6, Offset=-2)
rot3d_22 = Rotate3D(Geometry=pln_12, Angle=degrees(pshift_6), Center=pln_12, Axis=deplane_13.YAxis)  # -> Geometry, Transform

subtraction_7 = Subtraction(A=number_slider_42, B=lng_6)
repeat_7 = RepeatData(Data="30", Length=subtraction_7)
ins_7 = InsertItems(List=merge_8, Item=repeat_7, Indices=lng_6, Wrap=invert(True))
pshift_7 = ShiftPaths(Data=ins_7, Offset=-2)
rot3d_23 = Rotate3D(Geometry=pln_13, Angle=degrees(pshift_7), Center=pln_13, Axis=deplane_14.YAxis)  # -> Geometry, Transform

subtraction_8 = Subtraction(A=number_slider_42, B=lng_7)
repeat_8 = RepeatData(Data="45", Length=subtraction_8)
ins_8 = InsertItems(List=merge_9, Item=repeat_8, Indices=lng_7, Wrap=invert(True))
pshift_8 = ShiftPaths(Data=ins_8, Offset=-2)
rot3d_24 = Rotate3D(Geometry=pln_14, Angle=degrees(pshift_8), Center=pln_14, Axis=deplane_15.YAxis)  # -> Geometry, Transform

panel_11 = Panel(pshift_8)

subtraction_9 = Subtraction(A=number_slider_42, B=lng_8)
repeat_9 = RepeatData(Data="40", Length=subtraction_9)
ins_9 = InsertItems(List=merge_10, Item=repeat_9, Indices=lng_8, Wrap=invert(True))
pshift_9 = ShiftPaths(Data=ins_9, Offset=-2)
rot3d_25 = Rotate3D(Geometry=pln_15, Angle=degrees(pshift_9), Center=pln_15, Axis=deplane_16.YAxis)  # -> Geometry, Transform

subtraction_10 = Subtraction(A=number_slider_42, B=lng_9)
repeat_10 = RepeatData(Data="35", Length=subtraction_10)
ins_10 = InsertItems(List=merge_11, Item=repeat_10, Indices=lng_9, Wrap=invert(True))
pshift_10 = ShiftPaths(Data=ins_10, Offset=-2)
rot3d_26 = Rotate3D(Geometry=pln_16, Angle=degrees(pshift_10), Center=pln_16, Axis=deplane_17.YAxis)  # -> Geometry, Transform

crv_25 = Curve(rot3d_5.Geometry)
flip_5 = FlipCurve(Curve=crv_25)  # -> Curve, Flag
divide_19 = DivideCurve(Curve=flip_5.Curve, Count=Slider(80, range=0..1000), Kinks=False)  # -> Points, Tangents, Parameters
hframe_19 = HorizontalFrame(Curve=flip_5.Curve, Parameter=divide_19.Parameters)
pflip_20 = FlipPlane(Plane=hframe_19, ReverseX=False, ReverseY=False, SwapAxes=True)
pln_19 = Plane(pflip_20)
deplane_20 = DeconstructPlane(Plane=pln_19)  # -> Origin, simplify(XAxis), YAxis, ZAxis
rot3d_27 = Rotate3D(Geometry=pln_19, Angle=degrees(10), Center=pln_19, Axis=deplane_20.YAxis)  # -> Geometry, Transform

crv_26 = Curve(rot3d_2.Geometry)
flip_6 = FlipCurve(Curve=crv_26)  # -> Curve, Flag
divide_20 = DivideCurve(Curve=flip_6.Curve, Count=Slider(80, range=0..1000), Kinks=False)  # -> Points, Tangents, Parameters
hframe_20 = HorizontalFrame(Curve=flip_6.Curve, Parameter=divide_20.Parameters)
pflip_21 = FlipPlane(Plane=hframe_20, ReverseX=False, ReverseY=False, SwapAxes=True)
pln_20 = Plane(pflip_21)
deplane_21 = DeconstructPlane(Plane=pln_20)  # -> Origin, simplify(XAxis), YAxis, ZAxis
rot3d_28 = Rotate3D(Geometry=pln_20, Angle=degrees(25), Center=pln_20, Axis=deplane_21.YAxis)  # -> Geometry, Transform

crv_27 = Curve(rot3d_3.Geometry)
flip_7 = FlipCurve(Curve=crv_27)  # -> Curve, Flag
divide_21 = DivideCurve(Curve=flip_7.Curve, Count=Slider(80, range=0..1000), Kinks=False)  # -> Points, Tangents, Parameters
hframe_21 = HorizontalFrame(Curve=flip_7.Curve, Parameter=divide_21.Parameters)
pflip_22 = FlipPlane(Plane=hframe_21, ReverseX=False, ReverseY=False, SwapAxes=True)
pln_21 = Plane(pflip_22)
deplane_22 = DeconstructPlane(Plane=pln_21)  # -> Origin, simplify(XAxis), YAxis, ZAxis
rot3d_29 = Rotate3D(Geometry=pln_21, Angle=degrees(20), Center=pln_21, Axis=deplane_22.YAxis)  # -> Geometry, Transform

crv_28 = Curve(rot3d_7.Geometry)
flip_8 = FlipCurve(Curve=crv_28)  # -> Curve, Flag
divide_22 = DivideCurve(Curve=flip_8.Curve, Count=Slider(80, range=0..1000), Kinks=False)  # -> Points, Tangents, Parameters
hframe_22 = HorizontalFrame(Curve=flip_8.Curve, Parameter=divide_22.Parameters)
pflip_23 = FlipPlane(Plane=hframe_22, ReverseX=False, ReverseY=False, SwapAxes=True)
pln_22 = Plane(pflip_23)
deplane_23 = DeconstructPlane(Plane=pln_22)  # -> Origin, simplify(XAxis), YAxis, ZAxis
rot3d_30 = Rotate3D(Geometry=pln_22, Angle=degrees(15), Center=pln_22, Axis=deplane_23.YAxis)  # -> Geometry, Transform

crv_29 = Curve(rot3d_6.Geometry)
flip_9 = FlipCurve(Curve=crv_29)  # -> Curve, Flag
divide_23 = DivideCurve(Curve=flip_9.Curve, Count=Slider(80, range=0..1000), Kinks=False)  # -> Points, Tangents, Parameters
hframe_23 = HorizontalFrame(Curve=flip_9.Curve, Parameter=divide_23.Parameters)
pflip_24 = FlipPlane(Plane=hframe_23, ReverseX=False, ReverseY=False, SwapAxes=True)
pln_23 = Plane(pflip_24)
deplane_24 = DeconstructPlane(Plane=pln_23)  # -> Origin, simplify(XAxis), YAxis, ZAxis
rot3d_31 = Rotate3D(Geometry=pln_23, Angle=degrees(40), Center=pln_23, Axis=deplane_24.YAxis)  # -> Geometry, Transform

crv_30 = Curve(rot3d_4.Geometry)
flip_10 = FlipCurve(Curve=crv_30)  # -> Curve, Flag
divide_24 = DivideCurve(Curve=flip_10.Curve, Count=Slider(80, range=0..1000), Kinks=False)  # -> Points, Tangents, Parameters
hframe_24 = HorizontalFrame(Curve=flip_10.Curve, Parameter=divide_24.Parameters)
pflip_25 = FlipPlane(Plane=hframe_24, ReverseX=False, ReverseY=False, SwapAxes=True)
pln_24 = Plane(pflip_25)
deplane_25 = DeconstructPlane(Plane=pln_24)  # -> Origin, simplify(XAxis), YAxis, ZAxis
rot3d_32 = Rotate3D(Geometry=pln_24, Angle=degrees(35), Center=pln_24, Axis=deplane_25.YAxis)  # -> Geometry, Transform

crv_31 = Curve(rot3d.Geometry)
flip_11 = FlipCurve(Curve=crv_31)  # -> Curve, Flag
divide_25 = DivideCurve(Curve=flip_11.Curve, Count=Slider(80, range=0..1000), Kinks=False)  # -> Points, Tangents, Parameters
hframe_25 = HorizontalFrame(Curve=flip_11.Curve, Parameter=divide_25.Parameters)
pflip_26 = FlipPlane(Plane=hframe_25, ReverseX=False, ReverseY=False, SwapAxes=True)
pln_25 = Plane(pflip_26)
deplane_26 = DeconstructPlane(Plane=pln_25)  # -> Origin, simplify(XAxis), YAxis, ZAxis
rot3d_33 = Rotate3D(Geometry=pln_25, Angle=degrees(30), Center=pln_25, Axis=deplane_26.YAxis)  # -> Geometry, Transform

crv_32 = Curve(rot3d_17.Geometry)
flip_12 = FlipCurve(Curve=crv_15)  # -> Curve, Flag
divide_26 = DivideCurve(Curve=flip_12.Curve, Count=Slider(80, range=0..1000), Kinks=False)  # -> Points, Tangents, Parameters
hframe_26 = HorizontalFrame(Curve=flip_12.Curve, Parameter=divide_26.Parameters)
pflip_27 = FlipPlane(Plane=hframe_26, ReverseX=False, ReverseY=False, SwapAxes=True)
pln_26 = Plane(pflip_27)
deplane_27 = DeconstructPlane(Plane=pln_26)  # -> Origin, simplify(XAxis), YAxis, ZAxis
rot3d_34 = Rotate3D(Geometry=pln_26, Angle=degrees(5), Center=pln_26, Axis=deplane_27.YAxis)  # -> Geometry, Transform

crv_33 = Curve(<curve referenced from the Rhino model>)
divide_27 = DivideCurve(Curve=crv_15, Count=Slider(80, range=0..1000), Kinks=False)  # -> Points, Tangents, Parameters
hframe_27 = HorizontalFrame(Curve=crv_33, Parameter=divide_27.Parameters)
pflip_28 = FlipPlane(Plane=hframe_27, ReverseX=invert(False), ReverseY=invert(False), SwapAxes=True)
pln_27 = Plane(pflip_28)
deplane_28 = DeconstructPlane(Plane=pln_27)  # -> Origin, simplify(XAxis), YAxis, ZAxis
rot3d_35 = Rotate3D(Geometry=pln_27, Angle=degrees(pshift_3), Center=pln_27, Axis=deplane_28.YAxis)  # -> Geometry, Transform

subtraction_11 = Subtraction(A=number_slider_42, B=lng_10)
repeat_11 = RepeatData(Data="10", Length=subtraction_11)
ins_11 = InsertItems(List=merge_12, Item=repeat_11, Indices=lng_10, Wrap=invert(True))
pshift_11 = ShiftPaths(Data=ins_11, Offset=-2)
rot3d_36 = Rotate3D(Geometry=pln_17, Angle=degrees(pshift_11), Center=pln_17, Axis=deplane_18.YAxis)  # -> Geometry, Transform

pt_2 = Point(<point referenced from the Rhino model>)
mesh_2 = Mesh(<mesh referenced from the Rhino model>)
xy_4 = XYPlane(Origin=pt_2)
deplane_29 = DeconstructPlane(Plane=xy_4)  # -> Origin, XAxis, YAxis, ZAxis
rot3d_37 = Rotate3D(Geometry=xy_4, Angle=degrees(Slider(-45, range=-90..90)), Center=pt_2, Axis=deplane_29.ZAxis)  # -> Geometry, Transform

rotate_2 = Rotate(Geometry=mesh_2, Angle=expr("-x", degrees(Slider(0, range=0..100))), Plane=PlaneXY(0, 0, 0))  # -> Geometry, Transform

tool_2 = CreateTool(Name="Bender", TCP=rot3d_37.Geometry, Weight=0, Mesh=rotate_2.Geometry)  # -> Tool, TCP

target_6 = CreateTarget(Plane=rot3d_14.Geometry, Motion=list_3, Tool=tool_2.Tool, IsCartesian=True)  # disabled
target_7 = CreateTarget(Plane=rot3d_13.Geometry, Tool=tool_2.Tool, IsCartesian=True)  # disabled
target_8 = CreateTarget(Plane=rot3d_15.Geometry, Tool=tool_2.Tool, IsCartesian=True)  # disabled

target_9 = CreateTarget(Plane=merge_13, Tool=tool_2.Tool, IsCartesian=True)  # disabled

end_11 = EndPoints(Curve=crv_24)  # -> Start, End
pflip_29 = FlipPlane(Plane=end_11.Start, ReverseX=invert(False), ReverseY=False, SwapAxes=invert(True))
setdo_3 = SetDO(DO=panel, Value="True")
wait_2 = Wait(Time=Slider(3, range=0..10))
setdo_4 = SetDO(DO=panel, Value="False")
merge_15 = Merge(Data1=setdo_3, Data2=wait_2, Data3=setdo_4)  # -> flatten(Result)
command_2 = CommandParameter(merge_15)
target_10 = CreateTarget(Plane=pflip_29, Tool=tool_2.Tool, Command=command_2, IsCartesian=True)

merge_16 = Merge(
    Data1=Slider(0, range=-180..180),
    Data2=Slider(0, range=-180..180),
    Data3=Slider(0, range=-180..180),
    Data4=Slider(0, range=-180..180),
    Data5=Slider(0, range=-180..180),
    Data6=Slider(0, range=-180..180))
degtorad_2 = DegreesToRadians(Degrees=merge_16, RobotSystem=load_robot, MechanicalGroup=0)
target_11 = CreateTarget(Joints=degtorad_2, Tool=tool_2.Tool, IsCartesian=False)

# ---- group: approach (continued)
rot3d_38 = Rotate3D(Geometry=pln_18, Angle=degrees(pshift_3), Center=pln_18, Axis=deplane_19.YAxis)  # -> Geometry, Transform
target_12 = CreateTarget(Plane=rot3d_38.Geometry, Tool=tool_2.Tool, IsCartesian=True)

# ----
target_13 = CreateTarget(Plane=rot3d_27.Geometry, Tool=tool_2.Tool, IsCartesian=True)

target_14 = CreateTarget(Plane=rot3d_28.Geometry, Tool=tool_2.Tool, IsCartesian=True)

target_15 = CreateTarget(Plane=rot3d_20.Geometry, Tool=tool_2.Tool, IsCartesian=True)

target_16 = CreateTarget(Plane=rot3d_21.Geometry, Tool=tool_2.Tool, IsCartesian=True)

target_17 = CreateTarget(Plane=rot3d_29.Geometry, Tool=tool_2.Tool, IsCartesian=True)

target_18 = CreateTarget(Plane=rot3d_22.Geometry, Tool=tool_2.Tool, IsCartesian=True)

target_19 = CreateTarget(Plane=rot3d_30.Geometry, Tool=tool_2.Tool, IsCartesian=True)

target_20 = CreateTarget(Plane=rot3d_23.Geometry, Tool=tool_2.Tool, IsCartesian=True)

target_21 = CreateTarget(Plane=rot3d_33.Geometry, Tool=tool_2.Tool, IsCartesian=True)

target_22 = CreateTarget(Plane=rot3d_31.Geometry, Tool=tool_2.Tool, IsCartesian=True)

target_23 = CreateTarget(Plane=rot3d_32.Geometry, Tool=tool_2.Tool, IsCartesian=True)

target_24 = CreateTarget(Plane=rot3d_36.Geometry, Tool=tool_2.Tool, IsCartesian=True)

target_25 = CreateTarget(Plane=rot3d_34.Geometry, Tool=tool_2.Tool, IsCartesian=True)

target_26 = CreateTarget(Plane=rot3d_24.Geometry, Tool=tool_2.Tool, IsCartesian=True)

target_27 = CreateTarget(Plane=rot3d_25.Geometry, Tool=tool_2.Tool, IsCartesian=True)

target_28 = CreateTarget(Plane=rot3d_26.Geometry, Tool=tool_2.Tool, IsCartesian=True)

target_29 = CreateTarget(Plane=rot3d_35.Geometry, Tool=tool_2.Tool, IsCartesian=True)

target_30 = CreateTarget(Plane=rot3d_16.Geometry, Tool=tool_2.Tool, IsCartesian=True)

panel_12 = Panel(setdo_3)

# ---- group: out of sheet
crv_34 = Curve(<curve referenced from the Rhino model>)
divide_28 = DivideCurve(Curve=crv_34, Count=Slider(20, range=0..1000), Kinks=False)  # -> Points, Tangents, Parameters
hframe_28 = HorizontalFrame(Curve=crv_34, Parameter=divide_28.Parameters)
pflip_30 = FlipPlane(Plane=hframe_28, ReverseX=invert(False), ReverseY=invert(False), SwapAxes=True)
pln_28 = Plane(pflip_30)
deplane_30 = DeconstructPlane(Plane=pln_28)  # -> Origin, XAxis, simplify(YAxis), ZAxis
rot3d_39 = Rotate3D(Geometry=pln_28, Angle=degrees("45"), Center=pln_28, Axis=deplane_30.YAxis)  # -> Geometry, Transform
target_31 = CreateTarget(Plane=rot3d_39.Geometry, Tool=tool_2.Tool, IsCartesian=True)

# ----
entwine_2 = Entwine(
    Branch00=target_11,
    Branch01=target_10,
    Branch02=target_30,
    Branch03=target_29,
    Branch04=target_25,
    Branch05=target_24,
    Branch06=target_13,
    Branch07=target_16,
    Branch08=target_19,
    Branch09=target_15,
    Branch010=target_17,
    Branch011=target_18,
    Branch012=target_14,
    Branch013=target_20,
    Branch014=target_21,
    Branch015=target_28,
    Branch016=target_23,
    Branch017=target_27,
    Branch018=target_22,
    Branch019=target_26,
    Branch020=target_31,
    Branch021=target_11,
    FlattenInputs=True)
program_2 = CreateProgram(Name="BENDER", RobotSystem=load_robot, Targets1=flatten(entwine_2), StepSize=1)  # -> Program, Code, Duration, Warnings, Errors
sim_2 = ProgramSimulation(Program=program_2.Program, Time=Slider(0, range=0..1), Normalized=True)  # -> SystemMeshes, JointRotations, Plane, Index, Time, Program, Errors
panel_13 = Panel(program_2.Code)
preview_2 = CustomPreview(Geometry=sim_2.SystemMeshes, Material=ColourSwatch(SwatchColor=RGB(102, 102, 102)))
